# Grasshopper definition Brick placing v1.gh (Grasshopper 1.0.7)
# plug-ins: Kangaroo2 Components

first_floor_0_yes_1_no = Panel("{1}")
select_what_walls_you_want = Panel("")

# ---- group: Input mesh make sure the centre is at the origin
mesh = Mesh(<mesh referenced from the Rhino model>)

# ----
panel = Panel("werkt prima")
panel_2 = Panel("Oude versies")
# Werkt maar is vrij matig
panel_3 = Panel("Nog mee bezig")

# ---- group: make the brick and rotate it / De rest is geschiedenis
panel_4 = Panel("0.115")
panel_5 = Panel("0.115")
panel_6 = Panel("0.250")
rectangle = Rectangle(Plane=PlaneXY(0, 0, 0), XSize=panel_5, YSize=panel_6, Radius=0)  # -> Rectangle, Length
box_rectangle = BoxRectangle(Rectangle=rectangle.Rectangle, Height=panel_4)

# ---- group: Find the edge and join them
mesh_2 = Mesh(mesh)
mesh_edges = MeshEdges(Mesh=mesh_2)  # -> NakedEdges, InteriorEdges, NonManifoldEdges
join_curves = JoinCurves(Curves=mesh_edges.NakedEdges, Preserve=False)

# ---- group: make the brick and rotate it
negative = Negative(Value=panel_5)
unit_x = UnitX(Factor=negative)
vector_xyz = VectorXYZ(XComponent=expr("x*0.5", panel_6), YComponent=expr("-x*0.5", panel_5), ZComponent=0)  # -> Vector, Length
vector_xyz_2 = VectorXYZ(XComponent=expr("x*0.5", panel_5), YComponent=expr("-x*0.5", panel_6), ZComponent=0)  # -> Vector, Length
rotate = Rotate(Geometry=box_rectangle, Angle=degrees("90"), Plane=PlaneXY(0, 0, 0))  # -> Geometry, Transform
move = Move(Geometry=box_rectangle, Motion=unit_x)  # -> Geometry, Transform
move_2 = Move(Geometry=move.Geometry, Motion=vector_xyz_2.Vector)  # -> Geometry, Transform
move_3 = Move(Geometry=rotate.Geometry, Motion=vector_xyz.Vector)  # -> Geometry, Transform

# ---- group: Raam initieren
unit_z = UnitZ(Factor="1.5")
xz_plane = XZPlane(Origin=unit_z)
circle = Circle(Plane=xz_plane, Radius="0.6")
deconstruct_arc = DeconstructArc(Arc=circle)  # -> BasePlane, Radius, Angle
divide_length = DivideLength(Curve=circle, Length="0.135")  # -> Points, Tangents, Parameters
deconstruct = Deconstruct(Point=deconstruct_arc.BasePlane)  # -> XComponent, YComponent, ZComponent
construct_point = ConstructPoint(XCoordinate=deconstruct.XComponent, YCoordinate=deconstruct.YComponent, ZCoordinate=expr("x+1", deconstruct.ZComponent))
unit_z_2 = UnitZ(Factor=expr("x*-0.5", panel_4))
line = Line(StartPoint=deconstruct_arc.BasePlane, EndPoint=construct_point)
line_2 = Line(StartPoint=deconstruct_arc.BasePlane, EndPoint=divide_length.Points)
xz_plane_2 = XZPlane(Origin=Point(0, 0, 0))
move_4 = Move(Geometry=move_2.Geometry, Motion=unit_z_2)  # -> Geometry, Transform
angle = Angle(VectorA=line, VectorB=line_2, Plane=xz_plane_2)  # -> Angle, Reflex
rotate_2 = Rotate(Geometry=move_4.Geometry, Angle=angle.Angle, Plane=xz_plane_2)  # -> Geometry, Transform
move_5 = Move(Geometry=rotate_2.Geometry, Motion=divide_length.Points)  # -> Geometry, Transform

# ---- group: Initeren deur
xz_plane_3 = XZPlane(Origin=Point(0, 0, 0))
unit_x_2 = UnitX(Factor=expr("x*-0.5", "1.5"))
rectangle_2 = Rectangle(Plane=xz_plane_3, XSize="1.5", YSize="1.5", Radius=0)  # -> Rectangle, Length
move_6 = Move(Geometry=rectangle_2.Rectangle, Motion=unit_x_2)  # -> Geometry, Transform
splitatcorners = SplitAtCorners(Poly=move_6.Geometry, Angle=1)  # -> Corners, Parts
panel_7 = Panel("""0
2""")
panel_8 = Panel("""1
2""")
list_item = ListItem(List=splitatcorners.Parts, Index=panel_7, Wrap=True)  # -> graft(Item)
list_item_2 = ListItem(List=splitatcorners.Parts, Index="1", Wrap=True)  # -> graft(Item)
list_item_3 = ListItem(List=splitatcorners.Corners, Index=panel_8, Wrap=True)  # -> graft(Item)
divide_length_2 = DivideLength(Curve=list_item, Length="0.125")  # -> Points, Tangents, Parameters
unit_z_3 = UnitZ(Factor=1)
curve_middle = CurveMiddle(Curve=list_item_2)
explode_tree = ExplodeTree(Data=list_item_3)  # -> Branch0, Branch1
arc_sed = ArcSED(Start=explode_tree.Branch0, End=explode_tree.Branch1, Direction=unit_z_3)  # -> Arc, Plane, Radius
deconstruct_2 = Deconstruct(Point=curve_middle)  # -> XComponent, YComponent, ZComponent
move_7 = Move(Geometry=move_4.Geometry, Motion=divide_length_2.Points)  # -> Geometry, Transform
construct_point_2 = ConstructPoint(
    XCoordinate=deconstruct_2.XComponent,
    YCoordinate=deconstruct_2.YComponent,
    ZCoordinate=expr("x+2", deconstruct_2.ZComponent))
divide_length_3 = DivideLength(Curve=arc_sed.Arc, Length="0.125")  # -> Points, Tangents, Parameters
line_3 = Line(StartPoint=curve_middle, EndPoint=construct_point_2)
xz_plane_4 = XZPlane(Origin=Point(0, 0, 0))
cull_index = CullIndex(List=divide_length_3.Points, Indices="0", Wrap=True)
line_4 = Line(StartPoint=cull_index, EndPoint=curve_middle)
angle_2 = Angle(VectorA=line_3, VectorB=line_4, Plane=xz_plane_4)  # -> Angle, Reflex
rotate_3 = Rotate(Geometry=move_4.Geometry, Angle=angle_2.Angle, Plane=xz_plane_4)  # -> Geometry, Transform
move_8 = Move(Geometry=rotate_3.Geometry, Motion=cull_index)  # -> Geometry, Transform
geometry = Geometry(flatten([move_8.Geometry, move_7.Geometry]))

# ---- group: Find the midpoint of the arc
radians = Radians(Degrees="80")
splitatcorners_2 = SplitAtCorners(Poly=join_curves, Angle=radians)  # -> Corners, Parts
curve_middle_2 = CurveMiddle(Curve=splitatcorners_2.Parts)
deconstruct_3 = Deconstruct(Point=curve_middle_2)  # -> XComponent, YComponent, ZComponent
construct_point_3 = ConstructPoint(XCoordinate=deconstruct_3.XComponent, YCoordinate=deconstruct_3.YComponent, ZCoordinate=0)
move_9 = Move(Geometry=construct_point_3, Motion=Vector(0, 0, 10))  # -> Geometry, Transform

# ---- group: Walls
radians_2 = Radians(Degrees="80")
splitatcorners_3 = SplitAtCorners(Poly=join_curves, Angle=radians_2)  # -> Corners, graft(Parts)
curve_middle_3 = CurveMiddle(Curve=splitatcorners_3.Parts)
end_points = EndPoints(Curve=splitatcorners_3.Parts)  # -> Start, End
line_5 = Line(StartPoint=end_points.Start, EndPoint=end_points.End)
deconstruct_4 = Deconstruct(Point=curve_middle_3)  # -> XComponent, YComponent, ZComponent
construct_point_4 = ConstructPoint(XCoordinate=deconstruct_4.XComponent, YCoordinate=deconstruct_4.YComponent, ZCoordinate=0)
unit_z_4 = UnitZ(Factor=1)
loft = Loft(
    Curves=[line_5, splitatcorners_3.Parts],
    Options={Adjust=False, Closed=False, LoftEnds=0, LoftSimp=0, LoftType=0, Rebuild=10, Refit=0.01})
contour = Contour(Shape=loft, Point=construct_point_4, Direction=unit_z_4, Distance="0.126")
divide_length_4 = DivideLength(Curve=contour, Length="0.250")  # -> Points, Tangents, Parameters
cull_index_2 = CullIndex(List=divide_length_4.Points, Indices="0", Wrap=True)
line_6 = Line(StartPoint="{0,0,0}", EndPoint=cull_index_2)
line_7 = Line(StartPoint="{0,0,0}", EndPoint="{5,0,0}")
xy_plane = XYPlane(Origin=Point(0, 0, 0))
angle_3 = Angle(VectorA=line_7, VectorB=line_6, Plane=xy_plane)  # -> Angle, Reflex
degrees = Degrees(Radians=angle_3.Angle)
ghpython_script = GhPythonScript(z=move_2.Geometry, y=move_3.Geometry, x=degrees)  # -> out, simplify(a)
# ---------- ghpython_script: Python ----------
__author__ = "jordy"
__version__ = "2021.10.11"

import rhinoscriptsyntax as rs

if x > 0 and x < 45:
    a =z
if x > 45 and x < 135:
    a =y
if x > 135 and x < 225:
    a =z
if x > 225 and x < 315:
    a =y
if x > 315 and x < 360:
    a =z
# ---------- end ghpython_script ----------
geometry_2 = Geometry(ghpython_script.a)
move_10 = Move(Geometry=simplify(geometry_2), Motion=cull_index_2)  # -> simplify(Geometry), Transform

# ---- group: Divide the curve to place the bricks
divide_length_5 = DivideLength(Curve=splitatcorners_2.Parts, Length="0.125")  # -> Points, Tangents, Parameters
point = Point(simplify(divide_length_5.Points))

# ---- group: Measure the angle in xy and see what brick to use / Create the lines to measure the angles with
point_2 = Point(point)
line_8 = Line(StartPoint="{0,10,0}", EndPoint="{0,0,0}")
line_9 = Line(StartPoint="{0,0,0}", EndPoint=point_2)

# ---- group: Measure the angle in xy and see what brick to use
xy_plane_2 = XYPlane(Origin=Point(0, 0, 0))
angle_4 = Angle(VectorA=line_9, VectorB=line_8, Plane=xy_plane_2)  # -> Angle, Reflex
degrees_2 = Degrees(Radians=angle_4.Angle)
ghpython_script_2 = GhPythonScript(z=move_2.Geometry, y=move_3.Geometry, x=degrees_2)  # -> out, simplify(a); same code as ghpython_script

# ----
unit_x_3 = UnitX(Factor=1)
list_item_4 = ListItem(List=simplify(flatten(splitatcorners_3.Parts)), Index="0", Wrap=True)
join_curves_2 = JoinCurves(Curves=flatten([list_item, arc_sed.Arc]), Preserve=False)  # -> flatten(Curves)
list_item_5 = ListItem(List=simplify(flatten(splitatcorners_3.Parts)), Index="1", Wrap=True)
list_item_6 = ListItem(List=simplify(flatten(splitatcorners_3.Parts)), Index="2", Wrap=True)
list_item_7 = ListItem(List=simplify(flatten(splitatcorners_3.Parts)), Index="3", Wrap=True)

# ---- group: Find the other angles and rotate accordignly
line_10 = Line(StartPoint=graft(construct_point_3), EndPoint=point)
line_11 = Line(StartPoint=construct_point_3, EndPoint=move_9.Geometry)
yz_plane = YZPlane(Origin=Point(0, 0, 0))
xz_plane_5 = XZPlane(Origin=Point(0, 0, 0))
angle_5 = Angle(VectorA=line_11, VectorB=line_10, Plane=yz_plane)  # -> Angle, Reflex
angle_6 = Angle(VectorA=line_11, VectorB=line_10, Plane=xz_plane_5)  # -> Angle, Reflex
rotate_4 = Rotate(Geometry=ghpython_script_2.a, Angle=angle_5.Angle, Plane=yz_plane)  # -> Geometry, Transform
rotate_5 = Rotate(Geometry=rotate_4.Geometry, Angle=angle_6.Angle, Plane=xz_plane_5)  # -> Geometry, Transform
move_11 = Move(Geometry=rotate_5.Geometry, Motion=point_2)  # -> Geometry, Transform

# ----
end_points_2 = EndPoints(Curve=join_curves_2)  # -> Start, End
line_12 = Line(StartPoint=end_points_2.Start, EndPoint=end_points_2.End)
join_curves_3 = JoinCurves(Curves=flatten([join_curves_2, line_12]), Preserve=False)
unit_y = UnitY(Factor="3")
move_12 = Move(Geometry=join_curves_3, Motion=unit_y)  # -> Geometry, Transform
loft_2 = Loft(
    Curves=[join_curves_3, move_12.Geometry],
    Options={Adjust=False, Closed=False, LoftEnds=0, LoftSimp=0, LoftType=0, Rebuild=10, Refit=0.01})
cap_holes = CapHoles(Brep=loft_2)
unit_y_2 = UnitY(Factor="2.5")
move_13 = Move(Geometry=geometry, Motion=unit_y_2)  # -> Geometry, Transform
trim_tree = TrimTree(Tree=move_10.Geometry, Depth=1)
tree_branch = TreeBranch(Tree=trim_tree, Path=select_what_walls_you_want, MaintainPaths=True)
trim_solid = TrimSolid(Shape=tree_branch, Cutters=move_13.Geometry)
trim_solid_2 = TrimSolid(Shape=trim_solid, Cutters=cap_holes)
muren_simpel = Geometry([loft, move_11.Geometry])
mesh_simple = Geometry(mesh)

mesh_3 = Mesh(mesh)
mesh_edges_2 = MeshEdges(Mesh=mesh_3)  # -> NakedEdges, InteriorEdges, NonManifoldEdges
radians_3 = Radians(Degrees="80")
join_curves_4 = JoinCurves(Curves=mesh_edges_2.NakedEdges, Preserve=False)
splitatcorners_4 = SplitAtCorners(Poly=join_curves_4, Angle=radians_3)  # -> Corners, Parts

# ---- group: Lower part dome
mesh_4 = Mesh(mesh)
contour_2 = Contour(Shape=mesh_4, Point=Point(0, 0, 0), Direction=Vector(0, 0, 1), Distance="0.125")  # -> simplify(Contours)
line_13 = Line(StartPoint="{5,0,0}", EndPoint="{0,0,0}")
xy_plane_3 = XYPlane(Origin=Point(0, 0, 0))
panel_9 = Panel("""0
-1""")

# ---- group: Upper part dome
beetje_hardcoden_is_oke = Panel("""{23}
{24}
{25}
{26}
{27}
{28}
{29}
{30}
{31}
{32}
{33}""")
split_tree = SplitTree(Data=contour_2, Masks=flatten(beetje_hardcoden_is_oke))  # -> Positive, Negative
curve = Curve(split_tree.Positive)
divide_length_6 = DivideLength(Curve=curve, Length="0.125")  # -> Points, Tangents, Parameters
line_14 = Line(StartPoint="{0,0,0}", EndPoint=divide_length_6.Points)
xy_plane_4 = XYPlane(Origin=Point(0, 0, 0))
align_plane = AlignPlane(Plane=xy_plane_4, Direction=line_14)  # -> Plane, Angle
rotate_6 = Rotate(Geometry=move_3.Geometry, Angle=align_plane.Angle, Plane=PlaneXY(0, 0, 0))  # -> Geometry, Transform
move_14 = Move(Geometry=rotate_6.Geometry, Motion=divide_length_6.Points)  # -> Geometry, Transform

# ----
point_3 = Point(flatten(divide_length_6.Points))
deconstruct_5 = Deconstruct(Point=point_3)  # -> XComponent, YComponent, ZComponent
sort_list = SortList(Keys=deconstruct_5.ZComponent)  # -> reverse(Keys), ValuesValuesA
list_item_8 = ListItem(List=sort_list.Keys, Index="0", Wrap=True)
unit_z_5 = UnitZ(Factor=list_item_8)
move_15 = Move(Geometry=splitatcorners_4.Corners, Motion=unit_z_5)  # -> simplify(graft(Geometry)), Transform

unit_y_3 = UnitY(Factor=expr("x*-0.5", panel_6))
geometry_3 = Geometry(box_rectangle)
unit_x_4 = UnitX(Factor=expr("-x", panel_5))
move_16 = Move(Geometry=geometry_3, Motion=unit_y_3)  # -> Geometry, Transform
move_17 = Move(Geometry=move_16.Geometry, Motion=unit_x_4)  # -> Geometry, Transform
geometry_4 = Geometry(graft([move_16.Geometry, move_17.Geometry]))
line_15 = Line(StartPoint=graft(splitatcorners_4.Corners), EndPoint=graft(move_15.Geometry))
rotate_7 = Rotate(Geometry=geometry_4, Angle=1.570796327, Plane=PlaneXY(0, 0, 0))  # -> Geometry, Transform
divide_length_7 = DivideLength(Curve=line_15, Length="0.125")  # -> simplify(Points), Tangents, Parameters
dispatch = Dispatch(List=divide_length_7.Points, DispatchPattern=[True, False])  # -> ListA, ListB
move_18 = Move(Geometry=geometry_4, Motion=flatten(dispatch.ListA))  # -> Geometry, Transform
move_19 = Move(Geometry=rotate_7.Geometry, Motion=flatten(dispatch.ListB))  # -> Geometry, Transform

# ---- group: Lower part dome (continued)
divide_length_8 = DivideLength(Curve=split_tree.Negative, Length="0.125")  # -> Points, Tangents, Parameters
line_16 = Line(StartPoint=divide_length_8.Points, EndPoint="{0,0,0}")
angle_7 = Angle(VectorA=line_16, VectorB=line_13, Plane=xy_plane_3)  # -> Angle, Reflex
rotate_8 = Rotate(Geometry=move_2.Geometry, Angle=angle_7.Angle, Plane=PlaneXY(0, 0, 0))  # -> Geometry, Transform
move_20 = Move(Geometry=rotate_8.Geometry, Motion=divide_length_8.Points)  # -> Geometry, Transform
cull_index_3 = CullIndex(List=move_20.Geometry, Indices=panel_9, Wrap=True)

# ----
explode_tree_2 = ExplodeTree(Data=move_15.Geometry)  # -> Branch0, Branch1, Branch2, Branch3
_4point_surface = _4PointSurface(
    CornerA=explode_tree_2.Branch0,
    CornerB=explode_tree_2.Branch1,
    CornerC=explode_tree_2.Branch2,
    CornerD=explode_tree_2.Branch3)
line_17 = Line(StartPoint=explode_tree_2.Branch1, EndPoint=explode_tree_2.Branch2)
line_18 = Line(StartPoint=explode_tree_2.Branch0, EndPoint=explode_tree_2.Branch1)
line_19 = Line(StartPoint=explode_tree_2.Branch2, EndPoint=explode_tree_2.Branch3)
line_20 = Line(StartPoint=explode_tree_2.Branch3, EndPoint=explode_tree_2.Branch0)
contour_3 = Contour(Shape=_4point_surface, Point=Point(0, 0, 0), Direction=unit_x_3, Distance="0.125")
divide_length_9 = DivideLength(Curve=contour_3, Length="0.250")  # -> Points, Tangents, Parameters
curve_middle_4 = CurveMiddle(Curve=line_17)
curve_middle_5 = CurveMiddle(Curve=line_18)
loft_3 = Loft(
    Curves=flatten([line_18, list_item_4]),
    Options={Adjust=False, Closed=False, LoftEnds=0, LoftSimp=0, LoftType=0, Rebuild=10, Refit=0.01})
loft_4 = Loft(
    Curves=flatten([line_17, list_item_5]),
    Options={Adjust=False, Closed=False, LoftEnds=0, LoftSimp=0, LoftType=0, Rebuild=10, Refit=0.01})
loft_5 = Loft(
    Curves=flatten([line_19, list_item_6]),
    Options={Adjust=False, Closed=False, LoftEnds=0, LoftSimp=0, LoftType=0, Rebuild=10, Refit=0.01})
curve_middle_6 = CurveMiddle(Curve=line_19)
loft_6 = Loft(
    Curves=flatten([line_20, list_item_7]),
    Options={Adjust=False, Closed=False, LoftEnds=0, LoftSimp=0, LoftType=0, Rebuild=10, Refit=0.01})
curve_middle_7 = CurveMiddle(Curve=line_20)
move_21 = Move(Geometry=move_2.Geometry, Motion=divide_length_9.Points)  # -> Geometry, Transform

deconstruct_6 = Deconstruct(Point=curve_middle_7)  # -> XComponent, YComponent, ZComponent
construct_point_5 = ConstructPoint(XCoordinate=deconstruct_6.XComponent, YCoordinate=deconstruct_6.YComponent, ZCoordinate=0)
unit_z_6 = UnitZ(Factor=1)
contour_4 = Contour(Shape=loft_6, Point=construct_point_5, Direction=unit_z_6, Distance="0.125")
split_list = SplitList(List=flatten(contour_4), Index="48")  # -> ListA, ListB
dispatch_2 = Dispatch(List=flatten(split_list.ListA), DispatchPattern=[True, False])  # -> ListA, ListB
curve_2 = Curve(dispatch_2.ListA)
end_points_3 = EndPoints(Curve=curve_2)  # -> Start, End
line_21 = Line(StartPoint=end_points_3.End, EndPoint=end_points_3.Start)
divide_length_10 = DivideLength(Curve=dispatch_2.ListB, Length="0.25")  # -> Points, Tangents, Parameters
divide_length_11 = DivideLength(Curve=line_21, Length="0.25")  # -> Points, Tangents, Parameters
cull_index_4 = CullIndex(List=divide_length_10.Points, Indices="0", Wrap=True)
cull_index_5 = CullIndex(List=divide_length_11.Points, Indices="0", Wrap=True)
move_22 = Move(Geometry=move_2.Geometry, Motion=[cull_index_5, cull_index_4])  # -> Geometry, Transform

deconstruct_7 = Deconstruct(Point=curve_middle_6)  # -> XComponent, YComponent, ZComponent
construct_point_6 = ConstructPoint(XCoordinate=deconstruct_7.XComponent, YCoordinate=deconstruct_7.YComponent, ZCoordinate=0)
unit_z_7 = UnitZ(Factor=1)
contour_5 = Contour(Shape=loft_5, Point=construct_point_6, Direction=unit_z_7, Distance="0.125")
split_list_2 = SplitList(List=flatten(contour_5), Index="48")  # -> ListA, ListB
dispatch_3 = Dispatch(List=flatten(split_list_2.ListA), DispatchPattern=[True, False])  # -> ListA, ListB
curve_3 = Curve(dispatch_3.ListA)
end_points_4 = EndPoints(Curve=curve_3)  # -> Start, End
line_22 = Line(StartPoint=end_points_4.End, EndPoint=end_points_4.Start)
divide_length_12 = DivideLength(Curve=dispatch_3.ListB, Length="0.25")  # -> Points, Tangents, Parameters
divide_length_13 = DivideLength(Curve=line_22, Length="0.25")  # -> Points, Tangents, Parameters
cull_index_6 = CullIndex(List=divide_length_12.Points, Indices="0", Wrap=True)
cull_index_7 = CullIndex(List=divide_length_13.Points, Indices="0", Wrap=True)
move_23 = Move(Geometry=move_3.Geometry, Motion=[cull_index_7, cull_index_6])  # -> Geometry, Transform

deconstruct_8 = Deconstruct(Point=curve_middle_4)  # -> XComponent, YComponent, ZComponent
construct_point_7 = ConstructPoint(XCoordinate=deconstruct_8.XComponent, YCoordinate=deconstruct_8.YComponent, ZCoordinate=0)
unit_z_8 = UnitZ(Factor=1)
contour_6 = Contour(Shape=loft_4, Point=construct_point_7, Direction=unit_z_8, Distance="0.125")
split_list_3 = SplitList(List=flatten(contour_6), Index="48")  # -> ListA, ListB
dispatch_4 = Dispatch(List=flatten(split_list_3.ListA), DispatchPattern=[True, False])  # -> ListA, ListB
curve_4 = Curve(dispatch_4.ListA)
end_points_5 = EndPoints(Curve=curve_4)  # -> Start, End
line_23 = Line(StartPoint=end_points_5.End, EndPoint=end_points_5.Start)
divide_length_14 = DivideLength(Curve=dispatch_4.ListB, Length="0.25")  # -> Points, Tangents, Parameters
divide_length_15 = DivideLength(Curve=line_23, Length="0.25")  # -> Points, Tangents, Parameters
cull_index_8 = CullIndex(List=divide_length_14.Points, Indices="0", Wrap=True)
cull_index_9 = CullIndex(List=divide_length_15.Points, Indices="0", Wrap=True)
move_24 = Move(Geometry=move_2.Geometry, Motion=[cull_index_9, cull_index_8])  # -> Geometry, Transform

deconstruct_9 = Deconstruct(Point=curve_middle_5)  # -> XComponent, YComponent, ZComponent
construct_point_8 = ConstructPoint(XCoordinate=deconstruct_9.XComponent, YCoordinate=deconstruct_9.YComponent, ZCoordinate=0)
unit_z_9 = UnitZ(Factor=1)
contour_7 = Contour(Shape=loft_3, Point=construct_point_8, Direction=unit_z_9, Distance="0.125")
split_list_4 = SplitList(List=flatten(contour_7), Index="48")  # -> ListA, ListB
dispatch_5 = Dispatch(List=flatten(split_list_4.ListA), DispatchPattern=[True, False])  # -> ListA, ListB
curve_5 = Curve(dispatch_5.ListA)
end_points_6 = EndPoints(Curve=curve_5)  # -> Start, End
line_24 = Line(StartPoint=end_points_6.End, EndPoint=end_points_6.Start)
divide_length_16 = DivideLength(Curve=dispatch_5.ListB, Length="0.25")  # -> Points, Tangents, Parameters
divide_length_17 = DivideLength(Curve=line_24, Length="0.25")  # -> Points, Tangents, Parameters
cull_index_10 = CullIndex(List=divide_length_16.Points, Indices="0", Wrap=True)
cull_index_11 = CullIndex(List=divide_length_17.Points, Indices="0", Wrap=True)
move_25 = Move(Geometry=move_3.Geometry, Motion=[cull_index_11, cull_index_10])  # -> Geometry, Transform

join_curves_5 = JoinCurves(Curves=flatten([split_list_4.ListB, split_list_3.ListB, split_list_2.ListB, split_list.ListB]), Preserve=False)
end_points_7 = EndPoints(Curve=join_curves_5)  # -> Start, End
deconstruct_10 = Deconstruct(Point=end_points_7.Start)  # -> XComponent, YComponent, ZComponent
sort_list_2 = SortList(Keys=deconstruct_10.ZComponent, ValuesValuesA=join_curves_5)  # -> Keys, ValuesValuesA
dispatch_6 = Dispatch(List=sort_list_2.ValuesValuesA, DispatchPattern=[True, False])  # -> ListA, ListB
xy_plane_5 = XYPlane(Origin=Point(0, 0, 0))
rotate_9 = Rotate(Geometry=dispatch_6.ListA, Angle=1.570796327, Plane=xy_plane_5)  # -> Geometry, Transform
divide_length_18 = DivideLength(Curve=[rotate_9.Geometry, dispatch_6.ListB], Length="0.250")  # -> Points, Tangents, Parameters
line_25 = Line(StartPoint="{0,10,0}", EndPoint="{0,0,0}")
line_26 = Line(StartPoint="{0,0,0}", EndPoint=divide_length_18.Points)
xy_plane_6 = XYPlane(Origin=Point(0, 0, 0))
angle_8 = Angle(VectorA=line_26, VectorB=line_25, Plane=xy_plane_6)  # -> Angle, Reflex
degrees_3 = Degrees(Radians=angle_8.Angle)
ghpython_script_3 = GhPythonScript(z=move_2.Geometry, y=move_3.Geometry, x=degrees_3)  # -> out, simplify(a)
# ---------- ghpython_script_3: Python ----------
__author__ = "jordy"
__version__ = "2021.10.11"

import rhinoscriptsyntax as rs

if x > 0 and x < 45:
    a =y
if x > 45 and x < 135:
    a =z
if x > 135 and x < 225:
    a =y
if x > 225 and x < 315:
    a =z
if x > 315 and x < 360:
    a =y
# ---------- end ghpython_script_3 ----------
move_26 = Move(Geometry=ghpython_script_3.a, Motion=divide_length_18.Points)  # -> Geometry, Transform

verdieping_simpel = Geometry([loft_3, loft_4, loft_5, loft_6, move_18.Geometry, move_19.Geometry, _4point_surface, move_21.Geometry])
mesh_bricks = Geometry([move_14.Geometry, cull_index_3, move_11.Geometry, tree_branch])
geometry_5 = Geometry(flatten([move_25.Geometry, move_24.Geometry, move_23.Geometry, move_22.Geometry, move_26.Geometry, move_18.Geometry, move_19.Geometry, move_21.Geometry]))
tree_branch_2 = TreeBranch(Tree=geometry_5, Path=first_floor_0_yes_1_no, MaintainPaths=True)
first_floor_bricks = Geometry(tree_branch_2)
