# Grasshopper definition Brick placing v2.gh (Grasshopper 1.0.7)
# plug-ins: Kangaroo2 Components, karambaGH

mesh = Mesh(<mesh referenced from the Rhino model>)
mesh_join = MeshJoin(Meshes=mesh)

# ---- group: De rest is geschiedenis
panel = Panel("0.125")
panel_2 = Panel("0.250")
rectangle = Rectangle(Plane=PlaneXY(0, 0, 0), XSize=panel, YSize=panel_2, Radius=0)  # -> Rectangle, Length
box_rectangle = BoxRectangle(Rectangle=rectangle.Rectangle, Height="0.125")

# ----
unit_y = UnitY(Factor=expr("x*-0.5", panel_2))
unit_x = UnitX(Factor=expr("x*-0.5", panel))
move = Move(Geometry=box_rectangle, Motion=unit_y)  # -> Geometry, Transform
move_2 = Move(Geometry=move.Geometry, Motion=unit_x)  # -> Geometry, Transform
rotate = Rotate(Geometry=move_2.Geometry, Angle=1.570796327, Plane=PlaneXY(0, 0, 0))  # -> Geometry, Transform

brick_y_richting = Geometry(move_2.Geometry)
brick_x_richting = Geometry(rotate.Geometry)

mesh_2 = Mesh(mesh_join)
bounding_box = BoundingBox(Content=mesh_2, Plane=PlaneXY(0, 0, 0))  # -> Box, Box_2
unit_z = UnitZ(Factor=1)
geometry = Geometry(bounding_box.Box)
contour = Contour(Shape=geometry, Point=Point(0, 0, 0), Direction=unit_z, Distance="0.125")
panel_3 = Panel("""1
0""")
dispatch = Dispatch(List=flatten(contour), DispatchPattern=panel_3)  # -> ListA, ListB
curve = Curve(dispatch.ListA)
splitatcorners = SplitAtCorners(Poly=curve, Angle=1)  # -> Corners, Parts
curve_2 = Curve(dispatch.ListB)
splitatcorners_2 = SplitAtCorners(Poly=curve_2, Angle=1)  # -> Corners, Parts
list_item = ListItem(List=splitatcorners.Parts, Index="0", Wrap=True)
list_item_2 = ListItem(List=splitatcorners.Parts, Index="1", Wrap=True)
list_item_3 = ListItem(List=splitatcorners_2.Parts, Index="0", Wrap=True)
list_item_4 = ListItem(List=splitatcorners_2.Parts, Index="1", Wrap=True)
list_item_5 = ListItem(List=flatten(list_item_2), Index="1", Wrap=True)
divide_length = DivideLength(Curve=list_item, Length="0.250")  # -> Points, Tangents, Parameters
list_item_6 = ListItem(List=flatten(list_item_4), Index="1", Wrap=True)
divide_length_2 = DivideLength(Curve=list_item_3, Length="0.125")  # -> Points, Tangents, Parameters
divide_length_3 = DivideLength(Curve=list_item_5, Length="0.125")  # -> Points, Tangents, Parameters
divide_length_4 = DivideLength(Curve=list_item_6, Length="0.250")  # -> Points, Tangents, Parameters
deconstruct = Deconstruct(Point=divide_length_3.Points)  # -> XComponent, YComponent, ZComponent
deconstruct_2 = Deconstruct(Point=divide_length_4.Points)  # -> XComponent, YComponent, ZComponent
unit_x_2 = UnitX(Factor=expr("-x", deconstruct.XComponent))
unit_x_3 = UnitX(Factor=expr("-x", deconstruct_2.XComponent))
move_3 = Move(Geometry=flatten(divide_length.Points), Motion=graft(unit_x_2))  # -> Geometry, Transform
move_4 = Move(Geometry=flatten(divide_length_2.Points), Motion=graft(unit_x_3))  # -> Geometry, Transform
point = Point(simplify(flatten(move_3.Geometry)))
mesh_3 = Mesh(mesh_2)
point_2 = Point(simplify(flatten(move_4.Geometry)))
mesh_closest_point = MeshClosestPoint(Point=point, Mesh=mesh_3)  # -> Point, Index, Parameter
mesh_closest_point_2 = MeshClosestPoint(Point=point_2, Mesh=mesh_3)  # -> Point, Index, Parameter
distance = Distance(PointA=point, PointB=mesh_closest_point.Point)
distance_2 = Distance(PointA=point_2, PointB=mesh_closest_point_2.Point)
ghpython_script = GhPythonScript(x=distance)  # -> a
# ---------- ghpython_script: Python ----------
__author__ = "jordy"
__version__ = "2021.10.18"

import rhinoscriptsyntax as rs

if x > 0.2:
    a = 0
else:
    a = 1
# ---------- end ghpython_script ----------
ghpython_script_2 = GhPythonScript(x=distance_2)  # -> a; same code as ghpython_script
cull_pattern = CullPattern(List=point, CullPattern=ghpython_script)
cull_pattern_2 = CullPattern(List=point_2, CullPattern=ghpython_script_2)
move_5 = Move(Geometry=brick_y_richting, Motion=cull_pattern)  # -> Geometry, Transform
move_6 = Move(Geometry=brick_x_richting, Motion=cull_pattern_2)  # -> Geometry, Transform
geometry_2 = Geometry([move_6.Geometry, move_5.Geometry])
point_3 = Point([cull_pattern_2, cull_pattern])

point_4 = Point([<point referenced from the Rhino model> x5000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])

range = Range(Domain="6000 to 7000", Steps="1000")  # disabled
sphere = Sphere(Base=PlaneXY(0, 0, 0), Radius="0.200")
list_item_7 = ListItem(List=point_4, Index=range, Wrap="0")
move_7 = Move(Geometry=sphere, Motion=list_item_7)  # -> Geometry, Transform
point_in_brep = PointInBrep(Brep=graft(move_7.Geometry), Point=flatten(point_4), Strict=False)
cull_pattern_3 = CullPattern(List=point_4, CullPattern=point_in_brep)
line = Line(StartPoint=graft(list_item_7), EndPoint=cull_pattern_3)
remove_duplicate_lines_karamba3d = RemoveDuplicateLinesKaramba3D(Line=line, LimitDistance=0.005)  # -> OutLine, Info, Indexes

line_2 = Line(remove_duplicate_lines_karamba3d.OutLine)
