# Grasshopper definition Stair script.gh (Grasshopper 1.0.7)

# ---- group: Input stairs
hoogte_platforms = Slider(0.18, range=0..1)
aantal_tredes = Slider(3, range=0..10)
hoogte_tredes = Slider(0.15, range=0..1)
breedte_tredes = Slider(0.3, range=0..1)
max_height = Slider(4.2, range=0..10)

# ---- group: Input arch below stairs
height = Slider(1.834, range=0..10)
thickness_wall = Slider(0.2, range=0..1)
width = Slider(1.8, range=0..3)

# ---- group: Input arch above stairs
height_2 = Slider(3.5, range=0..10)
thickness_wall_2 = Slider(0.3, range=0..1)

# ---- group: Number of desired stairs
expression = Expression(x=aantal_tredes, y=hoogte_tredes, z=hoogte_platforms, u=max_height, Expression="u/(x*y+z*3)")
round = Round(Number=expression)  # -> Nearest, Floor, Ceiling
series = Series(Start=1, Step=1, Count=round.Ceiling)
division = Division(A=5, B=round.Ceiling)
eval = Evaluate(F="x % 2 = 0", x=series)
eval_2 = Evaluate(F="x % 2 = 1", x=series)
cull = CullPattern(List=series, CullPattern=eval_2)
cull_2 = CullPattern(List=series, CullPattern=eval)
lng = ListLength(List=cull)
lng_2 = ListLength(List=cull_2)
subtraction = Subtraction(A=lng_2, B=1)
subtraction_2 = Subtraction(A=lng, B=1)

# ----
expression_2 = Expression(x=aantal_tredes, y=hoogte_tredes, z=round.Ceiling, u=max_height, Expression="u-(x*y*z)")
multiplication = Multiplication(A=round.Ceiling, B=2)
division_2 = Division(A=expression_2, B=multiplication)

# ---- group: arch above stairs
pt = ConstructPoint(XCoordinate=0, YCoordinate=0, ZCoordinate=0)
num = Number(division)
pt_2 = ConstructPoint(XCoordinate=0, YCoordinate=0, ZCoordinate=max_height)
Y = UnitY(Factor=num)
Y_2 = UnitY(Factor=num)
move = Move(Geometry=[pt_2, pt], Motion=Y)  # -> Geometry, Transform
pt_3 = ConstructPoint(XCoordinate=expr("5-x", thickness_wall_2), YCoordinate=0, ZCoordinate=0)
pt_4 = ConstructPoint(XCoordinate=2.5, YCoordinate=0, ZCoordinate=height_2)
pt_5 = ConstructPoint(XCoordinate=thickness_wall_2, YCoordinate=0, ZCoordinate=0)
Y_3 = UnitY(Factor=num)
item = ListItem(List=move.Geometry, Index=0, Wrap=True)
item_2 = ListItem(List=move.Geometry, Index=1, Wrap=True)
X = UnitX(Factor=5)
srf4pt = _4PointSurface(CornerA=pt, CornerB=pt_2, CornerC=item, CornerD=item_2)
kinkcrv = KinkyCurve(Vertices=[pt_5, pt_4, pt_3], Degree=3, Angle=Slider(180, range=0..1000))  # -> Curve, Length, Domain
move_2 = Move(Geometry=srf4pt, Motion=X)  # -> Geometry, Transform
move_3 = Move(Geometry=kinkcrv.Curve, Motion=Y_3)  # -> Geometry, Transform
demesh = DeconstructMesh(Mesh=move_2.Geometry)  # -> Vertices, Faces, Colours, Normals
demesh_2 = DeconstructMesh(Mesh=srf4pt)  # -> Vertices, Faces, Colours, Normals
loft = Loft(
    Curves=[kinkcrv.Curve, move_3.Geometry],
    Options={Adjust=False, Closed=False, LoftEnds=0, LoftSimp=0, LoftType=0, Rebuild=10, Refit=0.01})
item_3 = ListItem(List=demesh_2.Vertices, Index=0, Wrap=True)
item_4 = ListItem(List=demesh_2.Vertices, Index=1, Wrap=True)
item_5 = ListItem(List=demesh_2.Vertices, Index=2, Wrap=True)
item_6 = ListItem(List=demesh_2.Vertices, Index=3, Wrap=True)
item_7 = ListItem(List=demesh.Vertices, Index=0, Wrap=True)
item_8 = ListItem(List=demesh.Vertices, Index=3, Wrap=True)
item_9 = ListItem(List=demesh.Vertices, Index=2, Wrap=True)
item_10 = ListItem(List=demesh.Vertices, Index=1, Wrap=True)
srf4pt_2 = _4PointSurface(CornerA=item_5, CornerB=item_6, CornerC=item_8, CornerD=item_9)
ln = Line(StartPoint=item_3, EndPoint=pt_5)
ln_2 = Line(StartPoint=item_5, EndPoint=item_9)
ln_3 = Line(StartPoint=item_9, EndPoint=item_7)
ln_4 = Line(StartPoint=item_3, EndPoint=item_5)
ln_5 = Line(StartPoint=pt_3, EndPoint=item_7)
Z = UnitZ(Factor=Slider(0.85, range=0..10))
join = JoinCurves(Curves=[ln_4, ln_2, ln_3, ln, ln_5, kinkcrv.Curve], Preserve=False)
move_4 = Move(Geometry=item_5, Motion=Z)  # -> Geometry, Transform
move_5 = Move(Geometry=item_9, Motion=Z)  # -> Geometry, Transform
loft_2 = Loft(Curves=join, Options={Adjust=False, Closed=False, LoftEnds=0, LoftSimp=0, LoftType=0, Rebuild=10, Refit=0.01})
srf4pt_3 = _4PointSurface(CornerA=item_9, CornerB=item_5, CornerC=move_4.Geometry, CornerD=move_5.Geometry)
move_6 = Move(Geometry=[loft_2, srf4pt_3], Motion=Y_2)  # -> Geometry, Transform

# ----
Z_2 = UnitZ(Factor=division_2)

# ---- group: Arch below stairs
subtraction_3 = Subtraction(A=5, B=thickness_wall, C=width)
division_3 = Division(A=width, B=2)
subtraction_4 = Subtraction(A=5, B=division_3, C=thickness_wall)
pt_6 = ConstructPoint(XCoordinate=0, YCoordinate=expr("5-x", thickness_wall), ZCoordinate=0)
pt_7 = ConstructPoint(XCoordinate=0, YCoordinate=subtraction_3, ZCoordinate=0)
pt_8 = ConstructPoint(XCoordinate=0, YCoordinate=subtraction_4, ZCoordinate=height)
kinkcrv_2 = KinkyCurve(Vertices=[pt_6, pt_8, pt_7], Degree=3, Angle=Slider(640, range=0..1000))  # -> Curve, Length, Domain
X_2 = UnitX(Factor=5)
move_7 = Move(Geometry=kinkcrv_2.Curve, Motion=X_2)  # -> Geometry, Transform
loft_3 = Loft(
    Curves=[kinkcrv_2.Curve, move_7.Geometry],
    Options={Adjust=False, Closed=False, LoftEnds=0, LoftSimp=0, LoftType=0, Rebuild=10, Refit=0.01})

# ----
brep = Brep(loft_3)
brep_2 = Brep(loft)
brep_3 = Brep([move_6.Geometry, loft_2, srf4pt_3])
brep_4 = Brep(srf4pt_2)
brep_5 = Brep([srf4pt, move_2.Geometry])

# ---- group: Copying the stairs1
series_2 = Series(Start=2, Step=2, Count=subtraction)
series_3 = Series(Start=2, Step=2, Count=subtraction_2)
multiplication_2 = Multiplication(A=division, B=series_3)
multiplication_3 = Multiplication(A=division, B=series_2)
expression_3 = Expression(x=aantal_tredes, y=hoogte_tredes, z=division_2, u=series_2, Expression="(x*y+z*2)*u")
expression_4 = Expression(x=aantal_tredes, y=hoogte_tredes, z=division_2, u=series_3, Expression="(x*y+z*2)*u")
expression_5 = Expression(x=Slider(0, range=0..100), y=multiplication_3, z=expression_3, Expression="{x,y,z}")  # -> graft(R)
expression_6 = Expression(x=Slider(0, range=0..100), y=multiplication_2, z=expression_4, Expression="{x,y,z}")  # -> graft(R)

# ---- group: First platforms
multiplication_4 = Multiplication(A=aantal_tredes, B=breedte_tredes, C=2)
subtraction_5 = Subtraction(A=5, B=multiplication_4)
division_4 = Division(A=subtraction_5, B=3)
rectangle = Rectangle(Plane=PlaneXY(0, 0, 0), XSize=division_4, YSize=division, Radius=0)  # -> Rectangle, Length
Z_3 = UnitZ(Factor=division_2)
division_5 = Division(A=division_4, B=2)
boundary = BoundarySurfaces(Edges=rectangle.Rectangle)
subtraction_6 = Subtraction(A=2.5, B=division_5)
subtraction_7 = Subtraction(A=5, B=division_4)
extr = Extrude(Base=boundary, Direction=Z_3)
merge = Merge(Data1=0, Data2=subtraction_6, Data3=subtraction_7)
X_3 = UnitX(Factor=merge)
move_8 = Move(Geometry=extr, Motion=X_3)  # -> Geometry, Transform

# ---- group: First set of stairs
series_4 = Series(Start=0, Step=hoogte_tredes, Count=aantal_tredes)
series_5 = Series(Start=division_4, Step=breedte_tredes, Count=aantal_tredes)
rectangle_2 = Rectangle(Plane=PlaneXY(0, 0, 0), XSize=breedte_tredes, YSize=division, Radius=0)  # -> Rectangle, Length
Z_4 = UnitZ(Factor=hoogte_tredes)
boundary_2 = BoundarySurfaces(Edges=rectangle_2.Rectangle)
item_11 = ListItem(List=series_4, Index=-1, Wrap=True)
addition = Addition(A=item_11, B=hoogte_tredes, C=division_2)
extr_2 = Extrude(Base=boundary_2, Direction=Z_4)
multiplication_5 = Multiplication(A=aantal_tredes, B=breedte_tredes)
entwine = Entwine(Branch00=0, Branch01=addition, Branch02=0, FlattenInputs=True)  # -> flatten(Result)
X_4 = UnitX(Factor=series_5)
addition_2 = Addition(A=multiplication_5, B=division_4)
Z_5 = UnitZ(Factor=series_4)
X_5 = UnitX(Factor=5)

# ----
move_9 = Move(Geometry=extr_2, Motion=Z_2)  # -> Geometry, Transform

# ---- group: First set of stairs (continued)
move_10 = Move(Geometry=move_9.Geometry, Motion=X_4)  # -> Geometry, Transform
move_11 = Move(Geometry=move_10.Geometry, Motion=Z_5)  # -> Geometry, Transform
mirror = Mirror(Geometry=move_11.Geometry, Plane=PlaneYZ(0, 0, 0))  # -> Geometry, Transform
move_12 = Move(Geometry=mirror.Geometry, Motion=X_5)  # -> Geometry, Transform

# ---- group: First platforms (continued)
num_2 = Number(entwine)
Z_6 = UnitZ(Factor=num_2)
move_13 = Move(Geometry=move_8.Geometry, Motion=Z_6)  # -> Geometry, Transform

# ---- group: Second set of stairs
X_6 = UnitX(Factor=expr("-x", addition_2))
Y_4 = UnitY(Factor=division)
multiplication_6 = Multiplication(A=division_2, B=1)
move_14 = Move(Geometry=move_12.Geometry, Motion=Y_4)  # -> Geometry, Transform
addition_3 = Addition(A=addition, B=multiplication_6)
move_15 = Move(Geometry=move_14.Geometry, Motion=X_6)  # -> Geometry, Transform
Z_7 = UnitZ(Factor=addition_3)
move_16 = Move(Geometry=move_15.Geometry, Motion=Z_7)  # -> Geometry, Transform
mirror_2 = Mirror(Geometry=move_16.Geometry, Plane=PlaneYZ(0, 0, 0))  # -> Geometry, Transform
move_17 = Move(Geometry=mirror_2.Geometry, Motion=X_5)  # -> Geometry, Transform

# ---- group: Copying the stairs1 (continued)
move_18 = Move(Geometry=[move_17.Geometry, move_16.Geometry], Motion=expression_5)  # -> Geometry, Transform
move_19 = Move(Geometry=[move_11.Geometry, move_12.Geometry], Motion=expression_6)  # -> Geometry, Transform

# ----
brep_6 = Brep([move_18.Geometry, move_19.Geometry, move_17.Geometry, move_16.Geometry, move_12.Geometry, move_11.Geometry])

# ---- group: Copying the platforms
expression_7 = Expression(x=aantal_tredes, y=hoogte_tredes, z=division_2, Expression="x*y*2+4*z")
series_6 = Series(Start=0, Step=expression_7, Count=lng)
split = SplitList(List=series_6, Index=1)  # -> ListA, ListB
subtraction_8 = Subtraction(A=split.ListB, B=division_2)
subtraction_9 = Subtraction(A=round.Ceiling, B=1)
addition_4 = Addition(A=subtraction_8, B=division_2)
series_7 = Series(Start=1, Step=1, Count=subtraction_9)
sort = SortList(Keys=[subtraction_8, addition_4])  # -> Keys, ValuesA
item_12 = ListItem(List=addition_4, Index=0, Wrap=True)
multiplication_7 = Multiplication(A=series_7, B=division)
lng_3 = ListLength(List=sort.Keys)
item_13 = ListItem(List=subtraction_8, Index=-1, Wrap=True)
lng_4 = ListLength(List=multiplication_7)
subtraction_10 = Subtraction(A=lng_4, B=lng_3)
addition_5 = Addition(A=item_12, B=item_13)
multiplication_8 = Multiplication(A=subtraction_10, B=addition_5)
sort_2 = SortList(Keys=[multiplication_8, sort.Keys])  # -> flatten(Keys), ValuesA
larger = LargerThan(FirstNumber=sort_2.Keys, SecondNumber=0)  # -> LargerThan, OrEqualTo
cull_3 = CullPattern(List=sort_2.Keys, CullPattern=larger.LargerThan)
expression_8 = Expression(x=Slider(0, range=0..100), y=multiplication_7, z=cull_3, Expression="{x,y,z}")
move_20 = Move(Geometry=extr, Motion=expression_8)  # -> Geometry, Transform
cull_i = CullIndex(List=expression_8, Indices=-1, Wrap=True)
cull_i_2 = CullIndex(List=cull_i, Indices=-1, Wrap=True)

# ---- group: Creating walls
item_14 = ListItem(List=move_13.Geometry, Index=1, Wrap=True)
item_15 = ListItem(List=move_8.Geometry, Index=2, Wrap=True)
debrep = DeconstructBrep(Brep=item_15)  # -> Faces, Edges, Vertices
expression_9 = Expression(x=Slider(0, range=0..100), y=division, z=division_2, Expression="{x,y,z}")
X_7 = UnitX(Factor=-5)
int = Integer([-1, -2])
debrep_2 = DeconstructBrep(Brep=move_20.Geometry)  # -> Faces, Edges, flatten(Vertices)
pt_9 = ConstructPoint(XCoordinate=5, YCoordinate=5, ZCoordinate=0)
int_2 = Integer([-1, -2])
item_16 = ListItem(List=move_13.Geometry, Index=1, Wrap=True)
int_3 = Integer([-1, -2])
item_17 = ListItem(List=move_13.Geometry, Index=0, Wrap=True)
subtraction_11 = Subtraction(A=lng_4, B=lng_3)
multiplication_9 = Multiplication(A=subtraction_11, B=1)
cull_i_3 = CullIndex(List=expression_8, Indices=0, Wrap=True)
item_18 = ListItem(List=move_13.Geometry, Index=2, Wrap=True)
move_21 = Move(Geometry=item_14, Motion=expression_9)  # -> Geometry, Transform
item_19 = ListItem(List=move_13.Geometry, Index=1, Wrap=True)
subtraction_12 = Subtraction(A=3, B=multiplication_9)
move_22 = Move(Geometry=pt_9, Motion=X_7)  # -> Geometry, Transform
item_20 = ListItem(List=debrep_2.Vertices, Index=int_3, Wrap=True)
debrep_3 = DeconstructBrep(Brep=item_17)  # -> Faces, Edges, Vertices
debrep_4 = DeconstructBrep(Brep=item_16)  # -> Faces, Edges, Vertices
debrep_5 = DeconstructBrep(Brep=item_18)  # -> Faces, Edges, Vertices
addition_6 = Addition(A=subtraction_11, B=2)
item_21 = ListItem(List=move_20.Geometry, Index=1, Wrap=True)
debrep_6 = DeconstructBrep(Brep=move_21.Geometry)  # -> Faces, Edges, Vertices
item_22 = ListItem(List=move_20.Geometry, Index=0, Wrap=True)
debrep_7 = DeconstructBrep(Brep=item_19)  # -> Faces, Edges, Vertices
debrep_8 = DeconstructBrep(Brep=move_21.Geometry)  # -> Faces, Edges, Vertices
series_8 = Series(Start=0, Step=subtraction_12, Count=Slider(3, range=0..10))
ln_6 = Line(StartPoint=pt_9, EndPoint=move_22.Geometry)
series_9 = Series(Start=0, Step=addition_6, Count=Slider(3, range=0..10))
item_23 = ListItem(List=debrep_3.Vertices, Index=1, Wrap=True)
item_24 = ListItem(List=debrep_3.Vertices, Index=5, Wrap=True)
item_25 = ListItem(List=debrep_4.Vertices, Index=0, Wrap=True)
item_26 = ListItem(List=debrep_4.Vertices, Index=1, Wrap=True)
item_27 = ListItem(List=debrep_5.Vertices, Index=0, Wrap=True)
item_28 = ListItem(List=debrep_5.Vertices, Index=4, Wrap=True)
item_29 = ListItem(List=debrep.Vertices, Index=[6, 7], Wrap=True)
item_30 = ListItem(List=debrep_6.Vertices, Index=5, Wrap=True)
item_31 = ListItem(List=debrep_7.Vertices, Index=2, Wrap=True)
debrep_9 = DeconstructBrep(Brep=item_22)  # -> Faces, Edges, Vertices
debrep_10 = DeconstructBrep(Brep=item_21)  # -> Faces, Edges, Vertices
item_32 = ListItem(List=cull_i_3, Index=series_8, Wrap=True)
item_33 = ListItem(List=cull_i_2, Index=expr("x+1", series_9), Wrap=True)
X_8 = UnitX(Factor=5)
item_34 = ListItem(List=item_29, Index=1, Wrap=True)
item_35 = ListItem(List=item_29, Index=0, Wrap=True)
item_36 = ListItem(List=debrep_8.Vertices, Index=7, Wrap=True)
item_37 = ListItem(List=debrep_8.Vertices, Index=6, Wrap=True)
ln_7 = Line(StartPoint=item_24, EndPoint=item_25)
ln_8 = Line(StartPoint=item_23, EndPoint=item_24)
ln_9 = Line(StartPoint=item_25, EndPoint=item_26)
ln_10 = Line(StartPoint=item_23, EndPoint=item_27)
ln_11 = Line(StartPoint=item_26, EndPoint=item_28)
ln_12 = Line(StartPoint=item_28, EndPoint=item_27)
item_38 = ListItem(List=debrep_9.Vertices, Index=10, Wrap=True)
item_39 = ListItem(List=debrep_10.Vertices, Index=5, Wrap=True)
move_23 = Move(Geometry=[pt_6, pt_7], Motion=X_8)  # -> Geometry, Transform
X_9 = UnitX(Factor=5)
join_2 = JoinCurves(Curves=[ln_8, ln_7, ln_9, ln_11, ln_12, ln_10], Preserve=False)
ln_13 = Line(StartPoint=item_38, EndPoint=item_36)
ln_14 = Line(StartPoint=item_37, EndPoint=item_36)
ln_15 = Line(StartPoint=item_38, EndPoint=item_39)
item_40 = ListItem(List=move_23.Geometry, Index=0, Wrap=True)
item_41 = ListItem(List=move_23.Geometry, Index=1, Wrap=True)
patch = Patch(Curves=join_2, Spans=20, Flexibility=1, Trim=True)
ln_16 = Line(StartPoint=pt_9, EndPoint=item_40)
ln_17 = Line(StartPoint=item_34, EndPoint=item_31)
ln_18 = Line(StartPoint=item_30, EndPoint=item_31)
ln_19 = Line(StartPoint=item_41, EndPoint=item_10)
ln_20 = Line(StartPoint=item_35, EndPoint=item_34)
X_10 = UnitX(Factor=-5)
X_11 = UnitX(Factor=-5)

# ---- group: Copying the platforms (continued)
move_24 = Move(Geometry=item_15, Motion=expression_8)  # -> Geometry, Transform
move_25 = Move(Geometry=move_21.Geometry, Motion=cull_i)  # -> Geometry, Transform

# ---- group: Creating walls (continued)
debrep_11 = DeconstructBrep(Brep=move_24.Geometry)  # -> Faces, Edges, flatten(Vertices)
debrep_12 = DeconstructBrep(Brep=move_25.Geometry)  # -> Faces, Edges, flatten(Vertices)
debrep_13 = DeconstructBrep(Brep=move_24.Geometry)  # -> Faces, Edges, flatten(Vertices)
lng_5 = ListLength(List=debrep_11.Faces)
item_42 = ListItem(List=debrep_12.Vertices, Index=int, Wrap=True)
item_43 = ListItem(List=debrep_13.Vertices, Index=int_2, Wrap=True)
division_6 = Division(A=lng_5, B=Slider(4, range=0..10))
item_44 = ListItem(List=move_24.Geometry, Index=1, Wrap=True)
item_45 = ListItem(List=move_25.Geometry, Index=0, Wrap=True)
item_46 = ListItem(List=move_24.Geometry, Index=0, Wrap=True)
item_47 = ListItem(List=debrep_11.Faces, Index=division_6, Wrap=True)
pline = PolyLine(Vertices=[item_20, item_42, item_43], Closed=False)
debrep_14 = DeconstructBrep(Brep=item_44)  # -> Faces, Edges, Vertices
debrep_15 = DeconstructBrep(Brep=item_45)  # -> Faces, Edges, Vertices
item_48 = ListItem(List=move_24.Geometry, Index=0, Wrap=True)
debrep_16 = DeconstructBrep(Brep=item_46)  # -> Faces, Edges, Vertices
debrep_17 = DeconstructBrep(Brep=item_47)  # -> Faces, Edges, Vertices
debrep_18 = DeconstructBrep(Brep=item_48)  # -> Faces, Edges, Vertices
item_49 = ListItem(List=debrep_15.Vertices, Index=0, Wrap=True)
item_50 = ListItem(List=debrep_15.Vertices, Index=1, Wrap=True)
item_51 = ListItem(List=debrep_14.Vertices, Index=12, Wrap=True)
item_52 = ListItem(List=debrep_16.Vertices, Index=3, Wrap=True)
item_53 = ListItem(List=debrep_17.Vertices, Index=[Slider(3, range=0..10), Slider(2, range=0..10)], Wrap=True)
item_54 = ListItem(List=debrep_18.Vertices, Index=[0, 1], Wrap=True)
shift = ShiftList(List=item_53, Shift=1, Wrap=True)  # -> flatten(List)
item_55 = ListItem(List=flatten(item_53), Index=1, Wrap=True)
item_56 = ListItem(List=flatten(item_53), Index=-2, Wrap=True)
ln_21 = Line(StartPoint=item_52, EndPoint=item_37)
ln_22 = Line(StartPoint=item_49, EndPoint=item_50)
item_57 = ListItem(List=item_54, Index=0, Wrap=True)
ln_23 = Line(StartPoint=item_39, EndPoint=item_49)
ln_24 = Line(StartPoint=item_51, EndPoint=item_52)
ln_25 = Line(StartPoint=item_51, EndPoint=item_50)
item_58 = ListItem(List=item_54, Index=1, Wrap=True)
pline_2 = PolyLine(Vertices=shift, Closed=False)  # -> flatten(Polyline)
ln_26 = Line(StartPoint=item_56, EndPoint=pt_9)
ln_27 = Line(StartPoint=item_57, EndPoint=item_58)
ln_28 = Line(StartPoint=item_57, EndPoint=item_30)
ln_29 = Line(StartPoint=item_35, EndPoint=item_58)
ln_30 = Line(StartPoint=item_55, EndPoint=item_10)
join_3 = JoinCurves(Curves=[ln_15, ln_23, ln_24, ln_25, ln_21, ln_22, ln_14, ln_13], Preserve=False)  # -> flatten(Curves)
join_4 = JoinCurves(Curves=[ln_20, ln_29, ln_18, ln_17, ln_27, ln_28], Preserve=False)
join_5 = JoinCurves(Curves=[ln_19, ln_16, ln_26, ln_30, move_7.Geometry, pline_2], Preserve=False)
patch_2 = Patch(Curves=join_3, Spans=20, Flexibility=1, Trim=True)
move_26 = Move(Geometry=patch_2, Motion=item_33)  # -> Geometry, Transform
patch_3 = Patch(Curves=join_4, Spans=20, Flexibility=1, Trim=True)
brep_7 = Brep(patch_3)
move_27 = Move(Geometry=brep_7, Motion=item_32)  # -> Geometry, Transform
mirror_3 = Mirror(Geometry=[move_27.Geometry, brep_7], Plane=PlaneYZ(0, 0, 0))  # -> Geometry, Transform
move_28 = Move(Geometry=mirror_3.Geometry, Motion=X_9)  # -> Geometry, Transform
patch_4 = Patch(Curves=join_5, Spans=20, Flexibility=1, Trim=True)
move_29 = Move(Geometry=ln_26, Motion=X_10)  # -> Geometry, Transform
join_6 = JoinCurves(Curves=[pline, ln_6, ln_26, move_29.Geometry], Preserve=False)
patch_5 = Patch(Curves=join_6, Spans=20, Flexibility=1, Trim=True)
move_30 = Move(Geometry=patch_4, Motion=X_11)  # -> Geometry, Transform

# ----
brep_8 = Brep([move_28.Geometry, move_27.Geometry, brep_7, move_26.Geometry, patch, patch_2])
brep_9 = Brep([patch_4, move_30.Geometry])
srf = Surface(patch_5)
brep_10 = Brep([move_24.Geometry, move_20.Geometry, move_13.Geometry, move_25.Geometry, move_21.Geometry])
