# Grasshopper definition Tessellation_and_Dynamic_Relaxation.gh (Grasshopper 1.0.7)
# plug-ins: Kangaroo2 Components

curve = Curve(<curve referenced from the Rhino model>)
curve_2 = Curve(<curve referenced from the Rhino model>)
curve_3 = Curve(<curve referenced from the Rhino model>)
curve_4 = Curve(<curve referenced from the Rhino model>)
curve_5 = Curve(<curve referenced from the Rhino model>)
curve_6 = Curve(<curve referenced from the Rhino model>)
curve_7 = Curve(<curve referenced from the Rhino model>)
curve_8 = Curve(<curve referenced from the Rhino model>)
divide_curve = DivideCurve(Curve=curve, Count="8", Kinks=False)  # -> Points, Tangents, Parameters
divide_curve_2 = DivideCurve(Curve=curve_3, Count="4", Kinks=False)  # -> Points, Tangents, Parameters
divide_curve_3 = DivideCurve(Curve=curve_2, Count="8", Kinks=False)  # -> Points, Tangents, Parameters
divide_curve_4 = DivideCurve(Curve=curve_4, Count="4", Kinks=False)  # -> Points, Tangents, Parameters
divide_curve_5 = DivideCurve(Curve=curve_5, Count="4", Kinks=False)  # -> Points, Tangents, Parameters
divide_curve_6 = DivideCurve(Curve=curve_7, Count="4", Kinks=False)  # -> reverse(Points), Tangents, Parameters
divide_curve_7 = DivideCurve(Curve=curve_6, Count="4", Kinks=False)  # -> Points, Tangents, Parameters
divide_curve_8 = DivideCurve(Curve=curve_8, Count="4", Kinks=False)  # -> Points, Tangents, Parameters
line = Line(StartPoint=divide_curve_3.Points, EndPoint=divide_curve.Points)
line_2 = Line(StartPoint=divide_curve_4.Points, EndPoint=divide_curve_2.Points)
line_3 = Line(StartPoint=divide_curve_7.Points, EndPoint=divide_curve_5.Points)
line_4 = Line(StartPoint=divide_curve_8.Points, EndPoint=divide_curve_6.Points)
line_5 = Line([line, line_2, line_3, line_4])
rotate = Rotate(Geometry=line_5, Angle=1.570796327, Plane=PlaneXY(0, 0, 0))  # -> Geometry, Transform
unit_x = UnitX(Factor=2.5)
unit_x_2 = UnitX(Factor=5)
unit_x_3 = UnitX(Factor=2.5)
unit_y = UnitY(Factor=2.5)
unit_y_2 = UnitY(Factor=2.5)
move = Move(Geometry=rotate.Geometry, Motion=unit_x_2)  # -> Geometry, Transform
move_2 = Move(Geometry=line_5, Motion=unit_x_3)  # -> Geometry, Transform
move_3 = Move(Geometry=rotate.Geometry, Motion=unit_x)  # -> Geometry, Transform
move_4 = Move(Geometry=move_3.Geometry, Motion=unit_y)  # -> Geometry, Transform
move_5 = Move(Geometry=move_2.Geometry, Motion=unit_y_2)  # -> Geometry, Transform
curve_9 = Curve([<curve referenced from the Rhino model> x16])

# ---- group: Inputs formfinding
panel = Panel("-10 to 10")
length_factor = Slider(0.772, range=0..2)
stiffnes = Slider(5, range=0..20)
reset = Button()
solver = BooleanToggle(True)
force_on_mesh = Slider(0.03, range=0..1)

# ----
curve_10 = Curve(<curve referenced from the Rhino model>)
splitatcorners = SplitAtCorners(Poly=curve_10, Angle=1)  # -> Corners, Parts
mesh = Mesh([<mesh referenced from the Rhino model> x29])
divide_curve_9 = DivideCurve(Curve=splitatcorners.Parts, Count="20", Kinks=False)  # -> Points, Tangents, Parameters
mesh_join = MeshJoin(Meshes=mesh)
deconstruct_mesh = DeconstructMesh(Mesh=mesh_join)  # -> Vertices, Faces, Colours, Normals
point = Point([<point referenced from the Rhino model> x4])
edgelengths = EdgeLengths(Mesh=mesh_join, LengthFactor=length_factor, Strength=stiffnes)
anchor = Anchor(Point=point, Strength=10000)
vertexloads = VertexLoads(Mesh=mesh_join, Strength=force_on_mesh)
closest_point = ClosestPoint(Point=divide_curve_9.Points, Cloud=deconstruct_mesh.Vertices)  # -> simplify(graft(ClosestPoint)), CPIndex, Distance
show = Show(G=mesh_join)
anchorxyz = AnchorXYZ(Point=closest_point.ClosestPoint, X="1", Y="1", Z="0", Strength=1000)
solver_2 = Solver(
    GoalObjects=[anchor, edgelengths, vertexloads, show, anchorxyz],
    Reset=reset,
    Threshold=1e-15,
    Tolerance=0.0001,
    On=solver)  # -> I, V, O

curve_11 = Curve([line_5, move_5.Geometry, move.Geometry, move_4.Geometry, curve_9])

rectangle = Rectangle(Plane=PlaneXY(0, 0, 0), XSize="5", YSize="5", Radius=0)  # -> Rectangle, Length
unit_z = UnitZ(Factor=Slider(4.2, range=0..6))
boundary_surfaces = BoundarySurfaces(Edges=rectangle.Rectangle)
move_6 = Move(Geometry=boundary_surfaces, Motion=unit_z)  # -> Geometry, Transform

tree_branch = TreeBranch(Tree=solver_2.O, Path="{0}", MaintainPaths=True)
point_2 = Point(solver_2.V)
mesh_2 = Mesh(tree_branch)
unit_z_2 = UnitZ(Factor=Slider(5, range=0..10))
curve_12 = Curve([<curve referenced from the Rhino model> x8])
extrude = Extrude(Base=curve_12, Direction=unit_z_2)
mesh_split = MeshSplit(Mesh=mesh_2, Splitters=extrude)
mesh_edges = MeshEdges(Mesh=mesh_split)  # -> NakedEdges, InteriorEdges, NonManifoldEdges
curve_13 = Curve(mesh_edges.NakedEdges)
pipe = Pipe(Curve=curve_13, Radius="0.1", Caps=0)
