# Grasshopper definition Brick placing and fem calculation.gh (Grasshopper 1.0.7)
# plug-ins: karambaGH, Kangaroo2 Components

# ----
# Input mesh: place your dynamicly relaxed mesh here. Make sure there is only one mesh. Closed meshes will not have their interior filled with bricks.
input_mesh_dynamicly_relaxed = Mesh(<mesh referenced from the Rhino model>)
mesh_join = MeshJoin(Meshes=input_mesh_dynamicly_relaxed)

panel = Panel("prosess")
# Make sure rhino is in meters. the inputs are also in meters
panel_2 = Panel("Inputs and outputs")

# ---- group: Fem inputs
# Anchor points: Points that are on the floor. Find and input manually
# Connections between the bricks: lines between the points resembling the connections
# Midpoint of the bricks: the other points that do not touch the ground
connections_between_the_bricks = Curve(flatten([<curve referenced from the Rhino model> x5000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]))
midpoints_of_the_bricks = Point(flatten([<point referenced from the Rhino model> x4030]))
anchor_points = Point([<point referenced from the Rhino model> x76])

# ---- group: Brick size
width_brick = Panel("12.5")
length_brick = Panel("25")
division = Division(A=length_brick, B=2)

# ----
closest_point = ClosestPoint(Point=anchor_points, Cloud=midpoints_of_the_bricks)  # -> ClosestPoint, CPIndex, Distance
cull_index = CullIndex(List=midpoints_of_the_bricks, Indices=closest_point.CPIndex, Wrap=True)
young_s_modulus = Panel("10")
weight = Panel("12")
tensile = Panel("1000")
material_properties_karamba3d = MaterialPropertiesKaramba3D(
    FamilyOfMaterial="Steel",
    Name="adobe brick",
    YoungsModulus_kN_cm2=young_s_modulus,
    InPlaneShearModulus_kN_cm2=expr("x/2.5", young_s_modulus),
    TransverseShearModulus_kN_cm2=8076,
    SpecificWeight_kN_m3=weight,
    CoefficientOfThermalExpansion_1_C=1e-05,
    YieldStrength_kN_cm2=tensile,
    mode="Isotrop")
list_length = ListLength(List=midpoints_of_the_bricks)
area_of_the_module = Panel("25")
point = Point(midpoints_of_the_bricks)
cross_section_karamba3d = CrossSectionKaramba3D(
    FamilyNameOfCrossSection="DefaultCroSec",
    Material=material_properties_karamba3d,
    Height_cm=width_brick,
    UpperFlangeWidth_cm=division,
    LowerFlangeWidth_cm=division,
    mode="Trapezoid")
multiplication = Multiplication(A="-4", B=area_of_the_module)
multiplication_2 = Multiplication(A="-1", B=area_of_the_module)
multiplication_3 = Multiplication(A="-20.3", B=area_of_the_module)
division_2 = Division(A=multiplication, B=list_length)
division_3 = Division(A=multiplication_3, B=list_length)
division_4 = Division(A=multiplication_2, B=list_length)
unit_z = UnitZ(Factor=division_3)
unit_z_2 = UnitZ(Factor=division_2)
unit_z_3 = UnitZ(Factor=division_4)
unit_z_4 = UnitZ(Factor="-1")
support_karamba3d = SupportKaramba3D(PosInd=anchor_points, menu=[buttons(on, on, on, on, on, on)])
support_karamba3d_2 = SupportKaramba3D(PosInd=cull_index, menu=[buttons(off, off, off, off, off, off)])
line_to_beam_karamba3d = LineToBeamKaramba3D(
    Line=connections_between_the_bricks,
    Identifier="Brick connections",
    CrossSection=cross_section_karamba3d,
    New=True,
    Remove=True,
    LimitDistance_m=0.005)  # -> Element, Points, Info
loads_karamba3d = LoadsKaramba3D(ForceVector=unit_z, Local=False, PosInd=point, LCase="1", mode="Point")
loads_karamba3d_2 = LoadsKaramba3D(Vector=unit_z_4, LCase="0", mode="Gravity")
loads_karamba3d_3 = LoadsKaramba3D(ForceVector=unit_z_2, Local=False, PosInd=point, LCase="2", mode="Point")
loads_karamba3d_4 = LoadsKaramba3D(ForceVector=unit_z_3, Local=False, PosInd=point, LCase="0", mode="Point")
assemble_model_karamba3d = AssembleModelKaramba3D(
    Elem=flatten(line_to_beam_karamba3d.Element),
    Support=flatten([support_karamba3d, support_karamba3d_2]),
    Load=flatten([loads_karamba3d_2, loads_karamba3d_4, loads_karamba3d, loads_karamba3d_3]),
    LimitDistance_m=0.005)  # -> Model, Info, Mass_kg, CenterOfGravity
analyze_karamba3d = AnalyzeKaramba3D(Model=assemble_model_karamba3d.Model)  # -> CalculatedModel, MaximumDisplacement_cm, ResultingForceOfGravity_kN, ElasticEnergy_kNm
panel_3 = Panel(assemble_model_karamba3d.Mass_kg)
model_view_karamba3d = ModelViewKaramba3D(Model=analyze_karamba3d.CalculatedModel, ResultFactors=1, ResultCase=-1)  # -> Model, DeformedMesh, DeformedAxes, DeformedModel
beam_view_karamba3d = BeamViewKaramba3D(Model=model_view_karamba3d.Model)  # -> Model, MeshesOfRenderedBeams, DeformedBeamAxes, LegendColors, LegendTags
legend = Legend(Colour=beam_view_karamba3d.LegendColors, Tags=beam_view_karamba3d.LegendTags, LegendType=1)

# ---- group: Brick size
panel_4 = Panel("0.125")
panel_5 = Panel("0.250")
rectangle = Rectangle(Plane=PlaneXY(0, 0, 0), XSize=panel_4, YSize=panel_5, Radius=0)  # -> Rectangle, Length
box_rectangle = BoxRectangle(Rectangle=rectangle.Rectangle, Height="0.125")

# ----
mesh = Mesh(mesh_join)
bounding_box = BoundingBox(Content=mesh, Plane=PlaneXY(0, 0, 0))  # -> Box, Box_2
unit_z_5 = UnitZ(Factor=1)
geometry = Geometry(bounding_box.Box)
contour = Contour(Shape=geometry, Point=Point(0, 0, 0), Direction=unit_z_5, Distance="0.125")
panel_6 = Panel("""1
0""")
dispatch = Dispatch(List=flatten(contour), DispatchPattern=panel_6)  # -> ListA, ListB
curve = Curve(dispatch.ListA)
splitatcorners = SplitAtCorners(Poly=curve, Angle=1)  # -> Corners, Parts
curve_2 = Curve(dispatch.ListB)
splitatcorners_2 = SplitAtCorners(Poly=curve_2, Angle=1)  # -> Corners, Parts
list_item = ListItem(List=splitatcorners.Parts, Index="0", Wrap=True)
list_item_2 = ListItem(List=splitatcorners.Parts, Index="1", Wrap=True)
list_item_3 = ListItem(List=splitatcorners_2.Parts, Index="0", Wrap=True)
list_item_4 = ListItem(List=splitatcorners_2.Parts, Index="1", Wrap=True)
list_item_5 = ListItem(List=flatten(list_item_2), Index="1", Wrap=True)
divide_length = DivideLength(Curve=list_item, Length="0.250")  # -> Points, Tangents, Parameters
list_item_6 = ListItem(List=flatten(list_item_4), Index="1", Wrap=True)
divide_length_2 = DivideLength(Curve=list_item_3, Length="0.125")  # -> Points, Tangents, Parameters
divide_length_3 = DivideLength(Curve=list_item_5, Length="0.125")  # -> Points, Tangents, Parameters
divide_length_4 = DivideLength(Curve=list_item_6, Length="0.250")  # -> Points, Tangents, Parameters
deconstruct = Deconstruct(Point=divide_length_3.Points)  # -> XComponent, YComponent, ZComponent
deconstruct_2 = Deconstruct(Point=divide_length_4.Points)  # -> XComponent, YComponent, ZComponent
unit_x = UnitX(Factor=expr("-x", deconstruct.XComponent))
unit_x_2 = UnitX(Factor=expr("-x", deconstruct_2.XComponent))
move = Move(Geometry=flatten(divide_length.Points), Motion=graft(unit_x))  # -> Geometry, Transform
move_2 = Move(Geometry=flatten(divide_length_2.Points), Motion=graft(unit_x_2))  # -> Geometry, Transform
unit_y = UnitY(Factor=expr("x*-0.5", panel_5))
point_2 = Point(simplify(flatten(move.Geometry)))
mesh_2 = Mesh(mesh)
point_3 = Point(simplify(flatten(move_2.Geometry)))
mesh_closest_point = MeshClosestPoint(Point=point_2, Mesh=mesh_2)  # -> Point, Index, Parameter
unit_x_3 = UnitX(Factor=expr("x*-0.5", panel_4))
move_3 = Move(Geometry=box_rectangle, Motion=unit_y)  # -> Geometry, Transform
mesh_closest_point_2 = MeshClosestPoint(Point=point_3, Mesh=mesh_2)  # -> Point, Index, Parameter
distance = Distance(PointA=point_2, PointB=mesh_closest_point.Point)
move_4 = Move(Geometry=move_3.Geometry, Motion=unit_x_3)  # -> Geometry, Transform
distance_2 = Distance(PointA=point_3, PointB=mesh_closest_point_2.Point)
ghpython_script = GhPythonScript(x=distance)  # -> a
# ---------- ghpython_script: Python ----------
__author__ = "jordy"
__version__ = "2021.10.18"

import rhinoscriptsyntax as rs

if x > 0.2:
    a = 0
else:
    a = 1
# ---------- end ghpython_script ----------
rotate = Rotate(Geometry=move_4.Geometry, Angle=1.570796327, Plane=PlaneXY(0, 0, 0))  # -> Geometry, Transform
ghpython_script_2 = GhPythonScript(x=distance_2)  # -> a; same code as ghpython_script
cull_pattern = CullPattern(List=point_2, CullPattern=ghpython_script)
cull_pattern_2 = CullPattern(List=point_3, CullPattern=ghpython_script_2)
brick_y_richting = Geometry(move_4.Geometry)
brick_x_richting = Geometry(rotate.Geometry)
move_5 = Move(Geometry=brick_y_richting, Motion=cull_pattern)  # -> Geometry, Transform
move_6 = Move(Geometry=brick_x_richting, Motion=cull_pattern_2)  # -> Geometry, Transform
midpoints_of_the_bricks_2 = Point([cull_pattern_2, cull_pattern])
geometry_of_the_bricks = Geometry([move_6.Geometry, move_5.Geometry])

# ---- group: Find the connections between the bricks
# Watch out!
# split the search otherwise the sript will crash. Use the range to divide it. see midpoints of the bricks for the amount of points. 1000 at once is doable.
midpoints_of_the_bricks_3 = Point([<point referenced from the Rhino model> x5000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])
range = Range(Domain="0 to 1000", Steps="1000")
sphere = Sphere(Base=PlaneXY(0, 0, 0), Radius="0.200")
list_item_7 = ListItem(List=midpoints_of_the_bricks_3, Index=range, Wrap="0")
move_7 = Move(Geometry=sphere, Motion=list_item_7)  # -> Geometry, Transform
point_in_brep = PointInBrep(Brep=graft(move_7.Geometry), Point=flatten(midpoints_of_the_bricks_3), Strict=False)
cull_pattern_3 = CullPattern(List=midpoints_of_the_bricks_3, CullPattern=point_in_brep)
line = Line(StartPoint=graft(list_item_7), EndPoint=cull_pattern_3)

# ---- group: Look for dublicate lines and delete them
remove_duplicate_lines_karamba3d = RemoveDuplicateLinesKaramba3D(Line=line, LimitDistance=0.005)  # -> OutLine, Info, Indexes
line_2 = Line(remove_duplicate_lines_karamba3d.OutLine)
